# Dynamo graph Bridge_Dynamo_Final.dyn "Bridge_Dynamo_Final_With Arch_New11111111111111" (Dynamo 2.10.1.3976)

file_path = Filename("..\CSV Files\Foundation_Steel Column_New.csv")
boolean = BoolSelector(false)
importCSV = Data.ImportCSV(filePath=file_path, transpose=boolean)
watch = Watch(importCSV)
family_types = FamilyTypes("Steel_Column_Final:Steel_Column_Final")
number = DoubleInput(0)
number_2 = DoubleInput(1)
getItemAtIndex = List.GetItemAtIndex(list=importCSV, index=number_2)
watch_2 = Watch(getItemAtIndex)
number_3 = DoubleInput(4)
getItemAtIndex_2 = List.GetItemAtIndex(list=importCSV, index=number_3)
watch_3 = Watch(getItemAtIndex_2)
byCoordinates = Point.ByCoordinates(x=number, y=watch_2, z=watch_3)
levels = Levels("No levels available.")
byPointAndLevel = FamilyInstance.ByPointAndLevel(familyType=family_types, point=byCoordinates, level=levels)
string = StringInput("Height")
number_4 = DoubleInput(2)
getItemAtIndex_3 = List.GetItemAtIndex(list=importCSV, index=number_4)
watch_4 = Watch(getItemAtIndex_3)
setParameterByName = Element.SetParameterByName(element=byPointAndLevel, parameterName=string, value=watch_4)
watch_5 = Watch(setParameterByName)
number_5 = DoubleInput(55000)
family_types_2 = FamilyTypes("Deck:Deck")
number_6 = DoubleInput(0)
file_path_2 = Filename("..\CSV Files\Foundation_Details2.csv")
boolean_2 = BoolSelector(false)
importCSV_2 = Data.ImportCSV(filePath=file_path_2, transpose=boolean_2)
number_7 = DoubleInput(1)
getItemAtIndex_4 = List.GetItemAtIndex(list=importCSV_2, index=number_7)
number_8 = DoubleInput(230000)
byCoordinates_2 = Point.ByCoordinates(x=number_6, y=getItemAtIndex_4, z=number_8)
levels_2 = Levels("No levels available.")
byPointAndLevel_2 = FamilyInstance.ByPointAndLevel(familyType=family_types_2, point=byCoordinates_2, level=levels_2)
string_2 = StringInput("Length")
number_9 = DoubleInput(5)
getItemAtIndex_5 = List.GetItemAtIndex(list=importCSV_2, index=number_9)
setParameterByName_2 = Element.SetParameterByName(element=byPointAndLevel_2, parameterName=string_2, value=getItemAtIndex_5)
watch_6 = Watch(setParameterByName_2)
family_types_3 = FamilyTypes("Concrete column Adaptive:Concrete column Adaptive")
number_10 = DoubleInput(0)
file_path_3 = Filename("..\CSV Files\Foundation_Concrete Column.csv")
boolean_3 = BoolSelector(false)
importCSV_3 = Data.ImportCSV(filePath=file_path_3, transpose=boolean_3)
number_11 = DoubleInput(1)
getItemAtIndex_6 = List.GetItemAtIndex(list=importCSV_3, index=number_11)
watch_7 = Watch(getItemAtIndex_6)
number_12 = DoubleInput(4)
getItemAtIndex_7 = List.GetItemAtIndex(list=importCSV_3, index=number_12)
watch_8 = Watch(getItemAtIndex_7)
byCoordinates_3 = Point.ByCoordinates(x=number_10, y=watch_7, z=watch_8)
levels_3 = Levels("No levels available.")
byPointAndLevel_3 = FamilyInstance.ByPointAndLevel(familyType=family_types_3, point=byCoordinates_3, level=levels_3)
string_3 = StringInput("Height")
number_13 = DoubleInput(2)
getItemAtIndex_8 = List.GetItemAtIndex(list=importCSV_3, index=number_13)
watch_9 = Watch(getItemAtIndex_8)
setParameterByName_3 = Element.SetParameterByName(element=byPointAndLevel_3, parameterName=string_3, value=watch_9)
watch_10 = Watch(setParameterByName_3)
watch_11 = Watch(importCSV_3)
file_path_4 = Filename("..\CSV Files\Foundation_Basement_Final.csv")
boolean_4 = BoolSelector(false)
importCSV_4 = Data.ImportCSV(filePath=file_path_4, transpose=boolean_4)
watch_12 = Watch(importCSV_4)
family_types_4 = FamilyTypes("Concrete base adaptive:Concrete base adaptive")
number_14 = DoubleInput(0)
number_15 = DoubleInput(1)
getItemAtIndex_9 = List.GetItemAtIndex(list=importCSV_4, index=number_15)
watch_13 = Watch(getItemAtIndex_9)
number_16 = DoubleInput(0)
byCoordinates_4 = Point.ByCoordinates(x=number_14, y=watch_13, z=number_16)
levels_4 = Levels("No levels available.")
byPointAndLevel_4 = FamilyInstance.ByPointAndLevel(familyType=family_types_4, point=byCoordinates_4, level=levels_4)
string_4 = StringInput("Height")
number_17 = DoubleInput(4)
getItemAtIndex_10 = List.GetItemAtIndex(list=importCSV_4, index=number_17)
watch_14 = Watch(getItemAtIndex_10)
setParameterByName_4 = Element.SetParameterByName(element=byPointAndLevel_4, parameterName=string_4, value=watch_14)
watch_15 = Watch(setParameterByName_4)
family_types_5 = FamilyTypes("Rail 40:Rail 40")
number_18 = DoubleInput(500)
file_path_5 = Filename("..\CSV Files\Train 40.csv")
boolean_5 = BoolSelector(false)
importCSV_5 = Data.ImportCSV(filePath=file_path_5, transpose=boolean_5)
number_19 = DoubleInput(1)
getItemAtIndex_11 = List.GetItemAtIndex(list=importCSV_5, index=number_19)
watch_16 = Watch(getItemAtIndex_11)
number_20 = DoubleInput(233800)
byCoordinates_5 = FamilyInstance.ByCoordinates(familyType=family_types_5, x=number_18, y=watch_16, z=number_20)
family_types_6 = FamilyTypes("Rail 48:Rail 48")
number_21 = DoubleInput(500)
file_path_6 = Filename("..\CSV Files\Train 48.csv")
boolean_6 = BoolSelector(false)
importCSV_6 = Data.ImportCSV(filePath=file_path_6, transpose=boolean_6)
number_22 = DoubleInput(1)
getItemAtIndex_12 = List.GetItemAtIndex(list=importCSV_6, index=number_22)
watch_17 = Watch(getItemAtIndex_12)
number_23 = DoubleInput(233800)
byCoordinates_6 = FamilyInstance.ByCoordinates(familyType=family_types_6, x=number_21, y=watch_17, z=number_23)
family_types_7 = FamilyTypes("Rail 50:Rail 50")
number_24 = DoubleInput(500)
file_path_7 = Filename("..\CSV Files\Train 50.csv")
boolean_7 = BoolSelector(false)
importCSV_7 = Data.ImportCSV(filePath=file_path_7, transpose=boolean_7)
number_25 = DoubleInput(1)
getItemAtIndex_13 = List.GetItemAtIndex(list=importCSV_7, index=number_25)
watch_18 = Watch(getItemAtIndex_13)
number_26 = DoubleInput(233800)
byCoordinates_7 = FamilyInstance.ByCoordinates(familyType=family_types_7, x=number_24, y=watch_18, z=number_26)
family_types_8 = FamilyTypes("Rail 55:Rail 55")
number_27 = DoubleInput(500)
file_path_8 = Filename("..\CSV Files\Train 55.csv")
boolean_8 = BoolSelector(false)
importCSV_8 = Data.ImportCSV(filePath=file_path_8, transpose=boolean_8)
number_28 = DoubleInput(1)
getItemAtIndex_14 = List.GetItemAtIndex(list=importCSV_8, index=number_28)
watch_19 = Watch(getItemAtIndex_14)
number_29 = DoubleInput(233800)
byCoordinates_8 = FamilyInstance.ByCoordinates(familyType=family_types_8, x=number_27, y=watch_19, z=number_29)
family_types_9 = FamilyTypes("Rail 65:Rail 65")
number_30 = DoubleInput(500)
file_path_9 = Filename("..\CSV Files\Train 65.csv")
boolean_9 = BoolSelector(false)
importCSV_9 = Data.ImportCSV(filePath=file_path_9, transpose=boolean_9)
number_31 = DoubleInput(1)
getItemAtIndex_15 = List.GetItemAtIndex(list=importCSV_9, index=number_31)
watch_20 = Watch(getItemAtIndex_15)
number_32 = DoubleInput(233800)
byCoordinates_9 = FamilyInstance.ByCoordinates(familyType=family_types_9, x=number_30, y=watch_20, z=number_32)
file_path_10 = Filename("..\CSV Files\Foundation_Arch Column_Final.csv")
boolean_10 = BoolSelector(false)
importCSV_10 = Data.ImportCSV(filePath=file_path_10, transpose=boolean_10)
watch_21 = Watch(importCSV_10)
family_types_10 = FamilyTypes("Arch Column Adaptive:Arch Column Adaptive")
number_33 = DoubleInput(0)
number_34 = DoubleInput(1)
getItemAtIndex_16 = List.GetItemAtIndex(list=importCSV_10, index=number_34)
watch_22 = Watch(getItemAtIndex_16)
number_35 = DoubleInput(4)
getItemAtIndex_17 = List.GetItemAtIndex(list=importCSV_10, index=number_35)
watch_23 = Watch(getItemAtIndex_17)
byCoordinates_10 = Point.ByCoordinates(x=number_33, y=watch_22, z=watch_23)
levels_5 = Levels("No levels available.")
byPointAndLevel_5 = FamilyInstance.ByPointAndLevel(familyType=family_types_10, point=byCoordinates_10, level=levels_5)
string_5 = StringInput("Height")
number_36 = DoubleInput(2)
getItemAtIndex_18 = List.GetItemAtIndex(list=importCSV_10, index=number_36)
watch_24 = Watch(getItemAtIndex_18)
setParameterByName_5 = Element.SetParameterByName(element=byPointAndLevel_5, parameterName=string_5, value=watch_24)
watch_25 = Watch(setParameterByName_5)
family_types_11 = FamilyTypes("Arch:Arch")
number_37 = DoubleInput(0)
number_38 = DoubleInput(425000)
number_39 = DoubleInput(80000)
byCoordinates_11 = FamilyInstance.ByCoordinates(familyType=family_types_11, x=number_37, y=number_38, z=number_39)
