# Dynamo graph Example4_New.dyn (Dynamo 2.10.1.3976)

select_model_element = DSModelElementSelection()  # 1 picked in the model
string = StringInput("Diameter")
number_slider = DoubleSlider(700, range=600..1200 step 100)
setParameterByName = Element.SetParameterByName(element=select_model_element, parameterName=string, value=number_slider)
