# Dynamo graph Foundation_Location_Column_Deck.dyn (Dynamo 2.10.1.3976)

file_path = Filename(".\Foundation_Details2.csv")
boolean = BoolSelector(false)
importCSV = Data.ImportCSV(filePath=file_path, transpose=boolean)
watch = Watch(importCSV)
family_types = FamilyTypes("Steel 2:Steel 2")
number = DoubleInput(0)
number_2 = DoubleInput(1)
getItemAtIndex = List.GetItemAtIndex(list=importCSV, index=number_2)
watch_2 = Watch(getItemAtIndex)
number_3 = DoubleInput(4)
getItemAtIndex_2 = List.GetItemAtIndex(list=importCSV, index=number_3)
watch_3 = Watch(getItemAtIndex_2)
byCoordinates = Point.ByCoordinates(x=number, y=watch_2, z=watch_3)
levels = Levels("Ground Level")
byPointAndLevel = FamilyInstance.ByPointAndLevel(familyType=family_types, point=byCoordinates, level=levels)
string = StringInput("Height")
number_4 = DoubleInput(2)
getItemAtIndex_3 = List.GetItemAtIndex(list=importCSV, index=number_4)
watch_4 = Watch(getItemAtIndex_3)
setParameterByName = Element.SetParameterByName(element=byPointAndLevel, parameterName=string, value=watch_4)
watch_5 = Watch(setParameterByName)
number_5 = DoubleInput(55000)
family_types_2 = FamilyTypes("Deck:Deck")
number_6 = DoubleInput(0)
file_path_2 = Filename(".\Foundation_Details2.csv")
boolean_2 = BoolSelector(false)
importCSV_2 = Data.ImportCSV(filePath=file_path_2, transpose=boolean_2)
number_7 = DoubleInput(1)
getItemAtIndex_4 = List.GetItemAtIndex(list=importCSV_2, index=number_7)
number_8 = DoubleInput(230000)
byCoordinates_2 = Point.ByCoordinates(x=number_6, y=getItemAtIndex_4, z=number_8)
levels_2 = Levels("Level 1")
byPointAndLevel_2 = FamilyInstance.ByPointAndLevel(familyType=family_types_2, point=byCoordinates_2, level=levels_2)
string_2 = StringInput("Length")
number_9 = DoubleInput(5)
getItemAtIndex_5 = List.GetItemAtIndex(list=importCSV_2, index=number_9)
setParameterByName_2 = Element.SetParameterByName(element=byPointAndLevel_2, parameterName=string_2, value=getItemAtIndex_5)
watch_6 = Watch(setParameterByName_2)
