# Dynamo graph Foundation_Location_Column_New.dyn (Dynamo 2.10.1.3976)

byCoordinates = Point.ByCoordinates()
file_path = Filename(".\Foundation_Details2.csv")
boolean = BoolSelector(false)
importCSV = Data.ImportCSV(filePath=file_path, transpose=boolean)
watch = Watch(importCSV)
family_types = FamilyTypes("Steel_Adaptive:Steel_Adaptive")
number = DoubleInput(0)
number_2 = DoubleInput(1)
getItemAtIndex = List.GetItemAtIndex(list=importCSV, index=number_2)
watch_2 = Watch(getItemAtIndex)
number_3 = DoubleInput(4)
getItemAtIndex_2 = List.GetItemAtIndex(list=importCSV, index=number_3)
watch_3 = Watch(getItemAtIndex_2)
byCoordinates_2 = Point.ByCoordinates(x=number, y=watch_2, z=watch_3)
levels = Levels("Ground Level")
byPointAndLevel = FamilyInstance.ByPointAndLevel(familyType=family_types, point=byCoordinates_2, level=levels)
string = StringInput("Height")
number_4 = DoubleInput(0)
getItemAtIndex_3 = List.GetItemAtIndex(list=importCSV, index=number_4)
watch_4 = Watch(getItemAtIndex_3)
setParameterByName = Element.SetParameterByName(element=byPointAndLevel, parameterName=string, value=watch_4)
watch_5 = Watch(setParameterByName)
family_types_2 = FamilyTypes("Deck:Deck")
number_5 = DoubleInput(0)
number_6 = DoubleInput(55000)
number_7 = DoubleInput(230000)
byCoordinates_3 = Point.ByCoordinates(x=number_5, y=number_6, z=number_7)
levels_2 = Levels("Deck Level")
byPointAndLevel_2 = FamilyInstance.ByPointAndLevel(familyType=family_types_2, point=byCoordinates_3, level=levels_2)
string_2 = StringInput("Length")
number_8 = DoubleInput(65000)
setParameterByName_2 = Element.SetParameterByName(element=byPointAndLevel_2, parameterName=string_2, value=number_8)
watch_6 = Watch(setParameterByName_2)
