# Dynamo graph Foundation_Location_Steel Column_Deck_Concrete Column.dyn (Dynamo 2.10.1.3976)

file_path = Filename(".\Foundation_Steel Column_Without center part.csv")
boolean = BoolSelector(false)
importCSV = Data.ImportCSV(filePath=file_path, transpose=boolean)
watch = Watch(importCSV)
family_types = FamilyTypes("Steel_Column_Final:Steel_Column_Final")
number = DoubleInput(0)
number_2 = DoubleInput(1)
getItemAtIndex = List.GetItemAtIndex(list=importCSV, index=number_2)
watch_2 = Watch(getItemAtIndex)
number_3 = DoubleInput(4)
getItemAtIndex_2 = List.GetItemAtIndex(list=importCSV, index=number_3)
watch_3 = Watch(getItemAtIndex_2)
byCoordinates = Point.ByCoordinates(x=number, y=watch_2, z=watch_3)
levels = Levels("Level 1")
byPointAndLevel = FamilyInstance.ByPointAndLevel(familyType=family_types, point=byCoordinates, level=levels)
string = StringInput("Height")
number_4 = DoubleInput(2)
getItemAtIndex_3 = List.GetItemAtIndex(list=importCSV, index=number_4)
watch_4 = Watch(getItemAtIndex_3)
setParameterByName = Element.SetParameterByName(element=byPointAndLevel, parameterName=string, value=watch_4)
watch_5 = Watch(setParameterByName)
number_5 = DoubleInput(55000)
family_types_2 = FamilyTypes("Deck:Deck")
number_6 = DoubleInput(0)
file_path_2 = Filename(".\Foundation_Details2.csv")
boolean_2 = BoolSelector(false)
importCSV_2 = Data.ImportCSV(filePath=file_path_2, transpose=boolean_2)
number_7 = DoubleInput(1)
getItemAtIndex_4 = List.GetItemAtIndex(list=importCSV_2, index=number_7)
number_8 = DoubleInput(230000)
byCoordinates_2 = Point.ByCoordinates(x=number_6, y=getItemAtIndex_4, z=number_8)
levels_2 = Levels("Level 1")
byPointAndLevel_2 = FamilyInstance.ByPointAndLevel(familyType=family_types_2, point=byCoordinates_2, level=levels_2)
string_2 = StringInput("Length")
number_9 = DoubleInput(5)
getItemAtIndex_5 = List.GetItemAtIndex(list=importCSV_2, index=number_9)
setParameterByName_2 = Element.SetParameterByName(element=byPointAndLevel_2, parameterName=string_2, value=getItemAtIndex_5)
watch_6 = Watch(setParameterByName_2)
family_types_3 = FamilyTypes("Concrete column Adaptive:Concrete column Adaptive")
number_10 = DoubleInput(0)
file_path_3 = Filename(".\Foundation_Concrete Column_New1.csv")
boolean_3 = BoolSelector(false)
importCSV_3 = Data.ImportCSV(filePath=file_path_3, transpose=boolean_3)
number_11 = DoubleInput(1)
getItemAtIndex_6 = List.GetItemAtIndex(list=importCSV_3, index=number_11)
watch_7 = Watch(getItemAtIndex_6)
number_12 = DoubleInput(4)
getItemAtIndex_7 = List.GetItemAtIndex(list=importCSV_3, index=number_12)
watch_8 = Watch(getItemAtIndex_7)
byCoordinates_3 = Point.ByCoordinates(x=number_10, y=watch_7, z=watch_8)
levels_3 = Levels("Level 1")
byPointAndLevel_3 = FamilyInstance.ByPointAndLevel(familyType=family_types_3, point=byCoordinates_3, level=levels_3)
string_3 = StringInput("Height")
number_13 = DoubleInput(2)
getItemAtIndex_8 = List.GetItemAtIndex(list=importCSV_3, index=number_13)
watch_9 = Watch(getItemAtIndex_8)
setParameterByName_3 = Element.SetParameterByName(element=byPointAndLevel_3, parameterName=string_3, value=watch_9)
watch_10 = Watch(setParameterByName_3)
watch_11 = Watch(importCSV_3)
file_path_4 = Filename(".\Foundation_Basement_Final.csv")
boolean_4 = BoolSelector(false)
importCSV_4 = Data.ImportCSV(filePath=file_path_4, transpose=boolean_4)
watch_12 = Watch(importCSV_4)
family_types_4 = FamilyTypes("Concrete base adaptive:Concrete base adaptive")
number_14 = DoubleInput(0)
number_15 = DoubleInput(1)
getItemAtIndex_9 = List.GetItemAtIndex(list=importCSV_4, index=number_15)
watch_13 = Watch(getItemAtIndex_9)
number_16 = DoubleInput(0)
byCoordinates_4 = Point.ByCoordinates(x=number_14, y=watch_13, z=number_16)
levels_4 = Levels("Level 1")
byPointAndLevel_4 = FamilyInstance.ByPointAndLevel(familyType=family_types_4, point=byCoordinates_4, level=levels_4)
string_4 = StringInput("Height")
number_17 = DoubleInput(4)
getItemAtIndex_10 = List.GetItemAtIndex(list=importCSV_4, index=number_17)
watch_14 = Watch(getItemAtIndex_10)
setParameterByName_4 = Element.SetParameterByName(element=byPointAndLevel_4, parameterName=string_4, value=watch_14)
watch_15 = Watch(setParameterByName_4)
