# Dynamo graph Foundation_Location_Column.dyn (Dynamo 2.10.1.3976)

byCoordinates = Point.ByCoordinates()
file_path = Filename("..\Height_Details.csv")
boolean = BoolSelector(false)
importCSV = Data.ImportCSV(filePath=file_path, transpose=boolean)
watch = Watch(importCSV)
family_types = FamilyTypes("Column-with-capital-parametric:Column-with-capital-parametric")
number = DoubleInput(0)
getItemAtIndex = List.GetItemAtIndex(list=importCSV, index=number)
watch_2 = Watch(getItemAtIndex)
number_2 = DoubleInput(0)
number_3 = DoubleInput(0)
byCoordinates_2 = Point.ByCoordinates(x=watch_2, y=number_2, z=number_3)
levels = Levels("Level 1")
byPointAndLevel = FamilyInstance.ByPointAndLevel(familyType=family_types, point=byCoordinates_2, level=levels)
string = StringInput("Diameter")
number_4 = DoubleInput(1)
getItemAtIndex_2 = List.GetItemAtIndex(list=importCSV, index=number_4)
watch_3 = Watch(getItemAtIndex_2)
setParameterByName = Element.SetParameterByName(element=byPointAndLevel, parameterName=string, value=watch_3)
watch_4 = Watch(setParameterByName)
