# Dynamo graph Foundation_Location_Height.dyn (Dynamo 2.10.1.3976)

byCoordinates = Point.ByCoordinates()
file_path = Filename("M:\3rd Sem\Advanced BIM\Tutorial\Tutorial 03 - Dynamo-20230517\Height_Details.csv")
boolean = BoolSelector(false)
importCSV = Data.ImportCSV(filePath=file_path, transpose=boolean)
number = DoubleInput(0)
getItemAtIndex = List.GetItemAtIndex(list=importCSV, index=number)
number_slider = DoubleSlider(6, range=1..10 step 1)
getItemAtIndex_2 = List.GetItemAtIndex(list=getItemAtIndex, index=number_slider)
watch = Watch(getItemAtIndex_2)
family_types = FamilyTypes()  # nothing selected
code_block = CodeBlock {  }
byPointAndLevel = FamilyInstance.ByPointAndLevel()  # unwired: familyType, point, level
select_model_element = DSModelElementSelection()  # 1 picked in the model
string = StringInput("Diameter")
watch_2 = Watch(importCSV)
number_2 = DoubleInput(1)
getItemAtIndex_3 = List.GetItemAtIndex(list=watch_2, index=number_2)
getItemAtIndex_4 = List.GetItemAtIndex(list=getItemAtIndex_3, index=number_slider)
watch_3 = Watch(getItemAtIndex_4)
setParameterByName = Element.SetParameterByName(element=select_model_element, parameterName=string, value=watch_3)
