# Dynamo graph Foundation_Location_Column_11.dyn (Dynamo 2.10.1.3976)

byCoordinates = Point.ByCoordinates()
file_path = Filename("..\..\..\Documents\GitHub\Parametric-3D-Modelling-Of-Chenab-Bridge-India-Using-Revit\Foundation_Details.csv")
boolean = BoolSelector(false)
importCSV = Data.ImportCSV(filePath=file_path, transpose=boolean)
watch = Watch(importCSV)
family_types = FamilyTypes("Steel_Adaptive:Steel_Adaptive")
number = DoubleInput(0)
number_2 = DoubleInput(0)
getItemAtIndex = List.GetItemAtIndex(list=importCSV, index=number_2)
watch_2 = Watch(getItemAtIndex)
number_3 = DoubleInput(2)
getItemAtIndex_2 = List.GetItemAtIndex(list=importCSV, index=number_3)
watch_3 = Watch(getItemAtIndex_2)
byCoordinates_2 = Point.ByCoordinates(x=number, y=watch_2, z=watch_3)
levels = Levels("Ground Level")
byPointAndLevel = FamilyInstance.ByPointAndLevel(familyType=family_types, point=byCoordinates_2, level=levels)
string = StringInput("Height")
number_4 = DoubleInput(1)
getItemAtIndex_3 = List.GetItemAtIndex(list=importCSV, index=number_4)
watch_4 = Watch(getItemAtIndex_3)
setParameterByName = Element.SetParameterByName(element=byPointAndLevel, parameterName=string, value=watch_4)
watch_5 = Watch(setParameterByName)
